# Dynamo graph bifold.dyn (Dynamo 2.12.1.8246)

categories = Categories("OST_Doors")
all_elements_of_category = ElementsOfCategory(Category=categories)
code_block = CodeBlock { "angle"; }
bifold_door = DoubleSlider(51, range=0..90 step 1)
setParameterByName = Element.SetParameterByName(element=all_elements_of_category, parameterName=code_block, value=bifold_door)
